# Grasshopper definition skinPattern.ghx (Grasshopper 1.0.7)
# plug-ins: ScriptParasite

curve = Curve(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)

ghpython_script = GhPythonScript(file_name="skinPattern\skinPattern.py")  # -> path
# ---------- ghpython_script: Python ----------
a = ghdoc.Path

path = a.split('3d_printing_teamwork')[0]+r'3d_printing_teamwork\\'+file_name
# ---------- end ghpython_script ----------
read_file = ReadFile(File=ghpython_script, PerLineParse=False)

curve_2 = Curve(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)
divide_curve = DivideCurve(Curve=curve_2, Count=20, Kinks=True)  # -> Points, Tangents, Parameters
button = Button()

c_script = CSharpScript(
    zPoints=divide_curve.Points,
    zIteration=Slider(26, range=0..100),
    zReset=button,
    zRadius="2",
    zEdge=curve,
    zMaxCounts="1000",
    FilletRatio=Slider(0.45, range=0..1))  # -> out, zOutPoints, zOutTemp; inputs zPoints: list of Point3d, zIteration: Double, zReset: Boolean, zRadius: Double, zEdge: Curve, zMaxCounts: Int32, FilletRatio: Double
# ---------- c_script: C# ----------
    // if (zReset)
    // { zIteration = 0; }
    // zIteration++;




    List<Circle> circles = new List<Circle>();

    for (int iteration = 0; iteration < zIteration; iteration++)
    {
      List<Vector3d> totalVector = new List<Vector3d>();
      List<double> counts = new List<double>();
      for (int i = 0; i < zPoints.Count; i++)
      {
        totalVector.Add(new Vector3d(0, 0, 0));
        counts.Add(0);
      }
      for (int i = 0; i < zPoints.Count; i++)
        for (int j = i + 1; j < zPoints.Count; j++)
        {
          double distance = zPoints[i].DistanceTo(zPoints[j]);
          if (2 * zRadius < distance) continue;
          else
          {

            Vector3d subVector = zPoints[i] - zPoints[j];
            subVector.Unitize();
            subVector *= 0.5 * (2 * zRadius - distance);
            totalVector[i] += subVector;
            totalVector[j] -= subVector;
            counts[i] += 1;
            counts[j] += 1;

          }
        }
      for (int k = 0; k < zPoints.Count; k++)
        if (counts[k] != 0)
        {
          if (zEdge.Contains(zPoints[k]) == PointContainment.Inside)
          {
            Vector3d move = totalVector[k] / counts[k];
            zPoints[k] += move;
          }

        }
      if (zPoints.Count < zMaxCounts)
      {
        List<int> Indices = new List<int>();

        for (int i = 0; i < zPoints.Count - 1; i++)
        {
          if (zPoints[i].DistanceTo(zPoints[i + 1]) > zRadius)
          { Indices.Add(i + 1 + Indices.Count); }
        }
        foreach (int Index in Indices)
        {
          Point3d addPoint = 0.5 * (zPoints[Index - 1] + zPoints[Index]);
          zPoints.Insert(Index, addPoint);
        }
      }
    }

    FilletRatio = FilletRatio /2;
    List<NurbsCurve> curves = new List<NurbsCurve>();
    for (int i = 1; i < zPoints.Count - 1;i++){

      Point3d p0 = zPoints[i - 1];
      Point3d p1 = zPoints[i];
      Point3d p2 = zPoints[i + 1];

      Point3d t0 = new Point3d(FilletRatio * p0 + p1 * (1-FilletRatio ));

      Point3d t1 = new Point3d(FilletRatio * p2 + p1 * (1-FilletRatio ));
      curves.Add(new Arc(t0, new Vector3d(p1 - t0), t1).ToNurbsCurve());

    }


    zOutTemp = curves;

    zOutPoints = zPoints;
# ---------- c_script: C# additional code ----------
  int zIteration = 0;
# ---------- end c_script ----------
script_parasite = ScriptParasite(Enable=Toggle(True), Folder="C:\Zac\GitHub\3d_printing_teamwork\skinPattern\csharp")

ghpython_script_2 = GhPythonScript(Code=read_file, Points=divide_curve.Points, Reset=button, Radius="2", Edge=curve, MaxCounts="1000")  # -> Out, OutPoints
panel = Panel(ghpython_script_2.Out)

panel_2 = Panel(c_script.out)

circle = Circle(Plane=c_script.zOutTemp, Radius="2")
polyline = PolyLine(Vertices=c_script.zOutTemp, Closed=False)
geometry = Geometry(c_script.zOutTemp)
